# Dynamo graph Centering the Space Tag.dyn (Dynamo 2.3.0.5885)
# packages: Quasar 2.1.3, QuasarII 2021.25.101, Bakery 2019.5.8

categories = Categories("OST_MEPSpaces")
activeView = Quasar.ViewUtility.ActiveView()
all_elements_of_category_in_view = ElementsOfCategoryInView(Category=categories, View=activeView)
centerSpace = QuasarII.MEPSpaces.CenterSpace(Spaces=all_elements_of_category_in_view)
activeView_2 = Quasar.ViewUtility.ActiveView()
categories_2 = Categories("OST_MEPSpaceTags")
activeView_3 = Quasar.ViewUtility.ActiveView()
all_elements_of_category_in_view_2 = ElementsOfCategoryInView(Category=categories_2, View=activeView_3)
string = StringInput("4")
wait_then_passthrough = Custom[Wait Then Passthrough](anyData=all_elements_of_category_in_view_2, secondsToWait=string)  # package Bakery
spaceTagToSpace = QuasarII.MEPSpaces.SpaceTagToSpace(view=activeView_2, SpaceTags=wait_then_passthrough)
