# Dynamo graph Replacing Mark Value with Element ID.dyn (Dynamo 2.3.0.5885)

categories = Categories("OST_ElectricalFixtures")  # graph input
all_elements_of_category = ElementsOfCategory(Category=categories)
id = Element.Id(element=all_elements_of_category)
string_from_object = FromObject(obj=id)
setParameterByName = Element.SetParameterByName(element=all_elements_of_category, value=string_from_object)  # unwired: parameterName
